# Dynamo graph DWG_link_face_bis.dyn (Dynamo 2.16.4.10216)
# packages: Genius Loci 2024.5.29, archi-lab.net 2023.213.1722

# group: Select CAD & Bloc
select_model_element = DSModelElementSelection()  # 1 picked in the model
cad_block = Custom[CAD Block](importInstance=select_model_element)  # package Genius Loci; Get the location point, name and layer of the CAD blocks / XRefs from a CAD link or import. Please note : The non-uniform scaling of blocks is not supported (The X, Y and Z values ​​of the Block Scale must be the same).
code_block = CodeBlock(t2=cad_block.BlockName) { t1 = List.Sort(List.UniqueItems(t2)); }
dropdown_list_selector = DropdownListSelector(List=code_block)
categories = Categories("OST_Roofs")
categories_2 = Categories("OST_Ceilings")
list_create = List.Create(item0=categories, item1=categories_2)
select_model_element_2 = DSModelElementSelection()  # 1 picked in the model
family_types = FamilyTypes("CHU_LUM_Dalle_Encastree_LED:600x600_LED")

eq = cad_block.BlockName == dropdown_list_selector  # lacing=Longest
filterByBoolMask = List.FilterByBoolMask(list=cad_block.Rotation, mask=eq)
watch = Watch(filterByBoolMask.in)
ceiling = Math.Ceiling(number=watch)
flatten = List.Flatten()  # unwired: list
indexOf = List.IndexOf(list=flatten)  # unwired: element
map = List.Map(function=indexOf)  # unwired: list
getItemAtIndex = List.GetItemAtIndex(list=ceiling, index=map)
element_setrotation = Custom[Element SetRotation](degree=getItemAtIndex)  # package Genius Loci; Set the angle of the element around its local Z-axis. (Same as the Rotate command in Revit); unwired: element
eq_2 = cad_block.BlockName == dropdown_list_selector  # lacing=Longest
filterByBoolMask_2 = List.FilterByBoolMask(list=cad_block.OriginPoint, mask=eq_2)

# group: Get ROOMS
python_script = Python(IN[0]=filterByBoolMask_2.in)  # CPython3
# ---------- python_script.python (40 lines) ----------
import clr

# Références aux assemblies nécessaires
clr.AddReference("RevitNodes")
import Revit
clr.ImportExtensions(Revit.GeometryConversion)

clr.AddReference("RevitServices")
import RevitServices
from RevitServices.Persistence import DocumentManager

clr.AddReference("RevitAPI")
from Autodesk.Revit.DB import *

# Récupération du document Revit actuel
doc = DocumentManager.Instance.CurrentDBDocument

# Fonction d'unwrapping et de vérification de type "liste"
def uwlist(item):
    if not isinstance(item, list):
        item = [item]
    return UnwrapElement(item)

# Préparation des entrées Dynamo
points = uwlist(IN[0])
phase = doc.Phases[0]

# Récupération des salles pour chaque point
rooms = []
points_outside = []
for p in points:
    xyz = p.ToXyz()
    room = doc.GetSpaceAtPoint(xyz, phase)
    if room is not None:
        rooms.append(room)
    else:
        points_outside.append(p)

# Retour des résultats vers Dynamo
OUT = (rooms, points_outside)
# ----------------------------------------
code_block_2 = CodeBlock(r=python_script) { r[0]; r[1]; }

code_block_3 = CodeBlock { 200; }
byCenterPointRadius = Sphere.ByCenterPointRadius(centerPoint=code_block_2.out1, radius=code_block_3)  # frozen
ZAxis = Vector.ZAxis()
views = Views("{3D}")
levels = Levels("00")
python_script_2 = Python(IN[0]=filterByBoolMask_2.in, IN[1]=ZAxis, IN[2]=views, IN[3]=categories_2, IN[4]=select_model_element_2, IN[5]=family_types, IN[6]=levels)  # CPython3
# ---------- python_script_2.python (175 lines) ----------
# -*- coding: utf-8 -*-
import clr

clr.AddReference('RevitAPI')
clr.AddReference('RevitNodes')
clr.AddReference('RevitServices')

from Autodesk.Revit.DB import *
from RevitServices.Persistence import DocumentManager
from RevitServices.Transactions import TransactionManager

import Revit
clr.ImportExtensions(Revit.GeometryConversion)

doc = DocumentManager.Instance.CurrentDBDocument

# =============================================================================
# INPUTS
# IN[0] : Liste de points Dynamo (origines des rayons)
# IN[1] : Direction du rayon  ex. Vector.ByCoordinates(0, 0, -1)
# IN[2] : Vue 3D              (obligatoire pour ReferenceIntersector)
# IN[3] : Catégorie Dynamo    ex. Categories → "Plafonds"
# IN[4] : RevitLinkInstance   (fichier lié contenant les plafonds)
# IN[5] : FamilySymbol        (la dalle luminaire face-hosted)
# IN[6] : Level               (niveau de nomenclature)
# =============================================================================

points          = IN[0] if isinstance(IN[0], list) else [IN[0]]
direction       = IN[1]
view3D          = UnwrapElement(IN[2])
category        = IN[3]
linked_instance = UnwrapElement(IN[4])
family_symbol   = UnwrapElement(IN[5])
ref_level       = UnwrapElement(IN[6])

# --- Conversion direction Dynamo → XYZ Revit ---
dir_xyz = direction.ToRevitType()

# --- Document et transformation du lien ---
link_doc       = linked_instance.GetLinkDocument()
link_transform = linked_instance.GetTotalTransform()

# =============================================================================
# FONCTION UTILITAIRE : projection d'un vecteur dans le plan de la face
# Utilisée pour calculer ref_direction sans décalage de 90°
# =============================================================================
def project_on_plane(vector, normal):
    """
    Projette 'vector' dans le plan défini par 'normal'.
    Si BasisX est parallèle à la normale (plafond incliné), bascule sur BasisY.
    """
    dot = vector.DotProduct(normal)
    projected = XYZ(
        vector.X - dot * normal.X,
        vector.Y - dot * normal.Y,
        vector.Z - dot * normal.Z
    )
    if projected.GetLength() < 1e-9:
        dot2 = XYZ.BasisY.DotProduct(normal)
        projected = XYZ(
            XYZ.BasisY.X - dot2 * normal.X,
            XYZ.BasisY.Y - dot2 * normal.Y,
            XYZ.BasisY.Z - dot2 * normal.Z
        )
    return projected.Normalize()

# =============================================================================
# REFERENCE INTERSECTOR
# =============================================================================
try:
    cat_id = ElementId(int(category.Id))
except:
    cat_id = category.Id

cat_filter = ElementCategoryFilter(cat_id)
ri = ReferenceIntersector(cat_filter, FindReferenceTarget.Face, view3D)
ri.FindReferencesInRevitLinks = True

# =============================================================================
# TRANSACTION
# =============================================================================
TransactionManager.Instance.EnsureInTransaction(doc)

if not family_symbol.IsActive:
    family_symbol.Activate()
    doc.Regenerate()

placed_instances = []
errors           = []
no_hit_points    = []

# =============================================================================
# BOUCLE PRINCIPALE
# =============================================================================
for pt in points:
    try:
        pt_xyz = pt.ToRevitType()

        # --- Lancer le rayon ---
        ref_context = ri.FindNearest(pt_xyz, dir_xyz)
        if not ref_context:
            errors.append("Aucune intersection pour : {}".format(pt))
            no_hit_points.append(pt)
            continue

        raw_ref = ref_context.GetReference()

        # --- Point d'intersection exact sur la face (repère projet hôte) ---
        proj_pt = raw_ref.GlobalPoint

        # --- Vérifier que la référence est bien dans le lien ---
        if raw_ref.LinkedElementId == ElementId.InvalidElementId:
            errors.append("Référence hors lien pour : {}".format(pt))
            continue

        # --- Récupérer l'élément dans le document lié ---
        elem = link_doc.GetElement(raw_ref.LinkedElementId)
        if elem is None:
            errors.append("Élément non trouvé dans le lien pour : {}".format(pt))
            continue

        if not isinstance(elem, HostObject):
            errors.append("L'élément n'est pas un HostObject : {}".format(elem.Id))
            continue

        # --- Face inférieure via HostObjectUtils ---
        bottom_refs = HostObjectUtils.GetBottomFaces(elem)
        if not bottom_refs or len(bottom_refs) == 0:
            errors.append("Aucune face inférieure sur : {}".format(elem.Id))
            continue

        bottom_ref_local = bottom_refs[0]
        face = elem.GetGeometryObjectFromReference(bottom_ref_local)
        if face is None:
            errors.append("Face introuvable sur : {}".format(elem.Id))
            continue

        # --- Normale transformée dans le repère projet hôte ---
        face_normal = link_transform.OfVector(face.FaceNormal).Normalize()

        # --- Direction de référence : BasisX projeté dans le plan de la face ---
        # (évite la rotation de 90° causée par un CrossProduct direct)
        ref_direction = project_on_plane(XYZ.BasisX, face_normal)

        # --- Référence liée (obligatoire pour NewFamilyInstance sur un lien) ---
        linked_ref = bottom_ref_local.CreateLinkReference(linked_instance)

        # --- Placement de la famille face-hosted au point d'intersection ---
        new_instance = doc.Create.NewFamilyInstance(
            linked_ref,       # Référence de la face dans le lien
            proj_pt,          # Point exact d'intersection du rayon
            ref_direction,    # Direction d'orientation dans le plan de la face
            family_symbol     # Type de famille (face-hosted ou work-plane-based)
        )

        # --- Niveau de nomenclature ---
        schedule_level_param = new_instance.get_Parameter(
            BuiltInParameter.INSTANCE_SCHEDULE_ONLY_LEVEL_PARAM
        )
        if schedule_level_param is not None and not schedule_level_param.IsReadOnly:
            schedule_level_param.Set(ref_level.Id)

        placed_instances.append(new_instance)

    except Exception as e:
        errors.append("Erreur sur {} : {}".format(pt, str(e)))

TransactionManager.Instance.TransactionTaskDone()

# =============================================================================
# OUTPUTS
# OUT[0] : Instances placées
# OUT[1] : Liste des erreurs (pour débogage)
# =============================================================================
OUT = [placed_instances, errors]
# ----------------------------------------
code_block_4 = CodeBlock(x=python_script_2) { x[2]; }
byCenterPointRadius_2 = Sphere.ByCenterPointRadius(centerPoint=code_block_4, radius=code_block_3)
