# Dynamo graph PLAFOND_Align hatch_R27.dyn (Dynamo 4.2.1.5887)

ceiling_types = CeilingTypes("Plafond avec isolation")
levels = Levels("00")
python_script = Python(IN[0]=ceiling_types, IN[1]=levels)  # PythonNet3
# ---------- python_script.python (722 lines) ----------
import clr
import math

clr.AddReference("RevitAPI")
from Autodesk.Revit.DB import (
    XYZ, Line, Reference, ReferenceArray,
    HostObjectUtils, Transaction,
    ElementTransformUtils, FilteredElementCollector,
    BuiltInCategory, ViewPlan, ViewType,
    FillPatternTarget, UnitUtils, UnitTypeId
)

clr.AddReference("RevitServices")
from RevitServices.Persistence import DocumentManager
from RevitServices.Transactions import TransactionManager

doc = DocumentManager.Instance.CurrentDBDocument

# ==================================================
# PARAMETRES UTILISATEUR
# ==================================================

# False : analyse uniquement
# True  : alignement des calepinages
EXECUTE = True

# IN[0] : Ceiling Type (noeud Dynamo)
# IN[1] : Level (noeud Dynamo)

selected_type = UnwrapElement(IN[0])
selected_level = UnwrapElement(IN[1])

# ==================================================
# UNITES ET TOLERANCES
# ==================================================

def ft(value):
    return UnitUtils.ConvertToInternalUnits(
        value, UnitTypeId.Millimeters
    )

def mm(value):
    return round(
        UnitUtils.ConvertFromInternalUnits(
            value, UnitTypeId.Millimeters
        ), 3
    )

TOL = ft(0.5)
PROBE = ft(200.0)
EXTENT = ft(15000.0)

def eid(e):
    return str(e.Id.Value)

# ==================================================
# SELECTION DES PLAFONDS PAR TYPE ET NIVEAU
# ==================================================

if selected_type is None:
    raise Exception("IN[0] : type de plafond absent")

if selected_level is None:
    raise Exception("IN[1] : niveau absent")

type_id = selected_type.Id
level_id = selected_level.Id

ceilings = []

all_ceilings = (
    FilteredElementCollector(doc)
    .OfCategory(BuiltInCategory.OST_Ceilings)
    .WhereElementIsNotElementType()
    .ToElements()
)

for e in all_ceilings:
    if (
        e.GetTypeId() == type_id
        and e.LevelId == level_id
    ):
        ceilings.append(e)

ceilings.sort(key=lambda e: e.Id.Value)

# ==================================================
# VUES DU NIVEAU
# ==================================================

view_cache = {}

views = (
    FilteredElementCollector(doc)
    .OfClass(ViewPlan)
    .ToElements()
)

for v in views:
    if v.IsTemplate or v.GenLevel is None:
        continue

    if v.GenLevel.Id != level_id:
        continue

    if v.ViewType in (
        ViewType.FloorPlan,
        ViewType.CeilingPlan
    ):
        if v.ViewType not in view_cache:
            view_cache[v.ViewType] = v

def get_view(view_type):
    if view_type not in view_cache:
        raise Exception(
            "Vue requise introuvable : "
            + str(view_type)
        )
    return view_cache[view_type]

# ==================================================
# GEOMETRIE DU PLAFOND
# ==================================================

def center(e):
    bb = e.get_BoundingBox(None)

    if bb is None:
        raise Exception("BoundingBox absent")

    return XYZ(
        (bb.Min.X + bb.Max.X) / 2,
        (bb.Min.Y + bb.Max.Y) / 2,
        (bb.Min.Z + bb.Max.Z) / 2
    )

def bbox(e):
    bb = e.get_BoundingBox(None)
    return [
        bb.Min.X, bb.Min.Y, bb.Min.Z,
        bb.Max.X, bb.Max.Y, bb.Max.Z
    ]

def get_face(e, top):
    refs = list(
        HostObjectUtils.GetTopFaces(e)
        if top else
        HostObjectUtils.GetBottomFaces(e)
    )

    if len(refs) != 1:
        raise Exception(
            "Plafond avec plusieurs faces "
            "non pris en charge"
        )

    return refs[0]

# ==================================================
# DETECTION AUTOMATIQUE DES DIMENSIONS
# ==================================================

def get_pattern(e, face_ref):
    face = e.GetGeometryObjectFromReference(
        face_ref
    )

    material = doc.GetElement(
        face.MaterialElementId
    )

    if material is None:
        raise Exception("Materiau absent")

    pe = doc.GetElement(
        material.SurfaceForegroundPatternId
    )

    if pe is None:
        raise Exception("Motif absent")

    pattern = pe.GetFillPattern()

    if pattern.Target != FillPatternTarget.Model:
        raise Exception("Motif non modele")

    if pattern.GridCount != 2:
        raise Exception(
            "Seuls les quadrillages "
            "a deux familles sont acceptes"
        )

    periods = {}

    for i in range(pattern.GridCount):
        grid = pattern.GetFillGrid(i)

        angle = math.degrees(
            grid.Angle
        ) % 180.0

        # Lignes horizontales :
        # ecartement dans la direction Y
        if min(abs(angle), abs(angle-180)) < 0.01:
            axis = "Y"

        # Lignes verticales :
        # ecartement dans la direction X
        elif abs(angle-90) < 0.01:
            axis = "X"

        else:
            raise Exception(
                "Motif tourne non pris en charge : "
                + str(round(angle, 3))
            )

        period = abs(grid.Offset)

        if period <= TOL:
            raise Exception("Espacement invalide")

        if axis in periods:
            raise Exception(
                "Familles de motifs incompatibles"
            )

        periods[axis] = period

    if set(periods.keys()) != {"X", "Y"}:
        raise Exception("Grille orthogonale absente")

    return periods

def check_compatibility(top, bottom):
    for axis in ("X", "Y"):
        if abs(top[axis] - bottom[axis]) > TOL:
            raise Exception(
                "Espacements dessus/dessous "
                "differents suivant " + axis
            )

# ==================================================
# REFERENCES DU CALepinage
# ==================================================

def hatch_ref(face, index):
    stable = face.ConvertToStableRepresentation(
        doc
    )

    return Reference.ParseFromStableRepresentation(
        doc, stable + "/" + str(index)
    )

# ==================================================
# PLAN DE REFERENCE TEMPORAIRE
# ==================================================

def make_plane(axis, coordinate, view, p):
    z = view.GenLevel.ProjectElevation

    if axis == "X":
        a = XYZ(
            coordinate, p.Y-EXTENT, z
        )
        b = XYZ(
            coordinate, p.Y+EXTENT, z
        )
    else:
        a = XYZ(
            p.X-EXTENT, coordinate, z
        )
        b = XYZ(
            p.X+EXTENT, coordinate, z
        )

    return doc.Create.NewReferencePlane(
        a, b, XYZ.BasisZ, view
    )

def make_dimension(ref, plane, axis, view, p):
    refs = ReferenceArray()
    refs.Append(ref)
    refs.Append(plane.GetReference())

    z = view.GenLevel.ProjectElevation

    if axis == "X":
        a = XYZ(p.X-EXTENT, p.Y, z)
        b = XYZ(p.X+EXTENT, p.Y, z)
    else:
        a = XYZ(p.X, p.Y-EXTENT, z)
        b = XYZ(p.X, p.Y+EXTENT, z)

    dim = doc.Create.NewDimension(
        view,
        Line.CreateBound(a, b),
        refs
    )

    doc.Regenerate()

    if dim is None or dim.Value is None:
        raise Exception("Cote non mesurable")

    return dim

# ==================================================
# MESURE D'UNE LIGNE DE MOTIF
# ==================================================

def measure(ref, axis, coordinate, view, p):
    pl = None
    dim = None

    try:
        pl = make_plane(
            axis, coordinate, view, p
        )
        doc.Regenerate()

        dim = make_dimension(
            ref, pl, axis, view, p
        )

        return abs(float(dim.Value))

    finally:
        if dim is not None:
            doc.Delete(dim.Id)

        if pl is not None:
            doc.Delete(pl.Id)

        doc.Regenerate()

def coordinate_of(ref, axis, view, p):
    c0 = p.X if axis == "X" else p.Y

    coords = [
        c0,
        c0 + PROBE,
        c0 + 2*PROBE
    ]

    distances = [
        measure(ref, axis, c, view, p)
        for c in coords
    ]

    x = (
        distances[0]**2
        - distances[1]**2
        + coords[1]**2
        - coords[0]**2
    ) / (2*(coords[1]-coords[0]))

    for c, d in zip(coords, distances):
        if abs(abs(x-c)-d) > TOL:
            raise Exception(
                "Mesures incoherentes"
            )

    return x

# ==================================================
# CALCUL DU DECALAGE PERIODIQUE
# ==================================================

def wrap(value, period):
    return value - math.floor(
        value/period + 0.5
    )*period

def circular_phase(values, period):
    angles = [
        2*math.pi*v/period
        for v in values
    ]

    s = sum(math.sin(a) for a in angles)
    c = sum(math.cos(a) for a in angles)

    if math.hypot(s, c) < 1e-8:
        raise Exception(
            "Phase de grille ambigue"
        )

    return (
        math.atan2(s, c)
        *period/(2*math.pi)
    )

def extract_lines(face, view, p, periods):
    groups = {
        "X": [],
        "Y": []
    }

    for index in range(1, 13):
        try:
            ref = hatch_ref(face, index)
        except:
            continue

        candidates = {}

        for axis in ("X", "Y"):
            try:
                candidates[axis] = coordinate_of(
                    ref, axis, view, p
                )
            except:
                pass

        if len(candidates) == 1:
            axis = list(candidates.keys())[0]

            groups[axis].append({
                "index": index,
                "coord": candidates[axis]
            })

    for axis in ("X", "Y"):
        lines = groups[axis]

        if len(lines) < 2:
            raise Exception(
                "References insuffisantes "
                + axis
            )

        period = periods[axis]

        phase = circular_phase(
            [v["coord"] for v in lines],
            period
        )

        for v in lines:
            residual = wrap(
                v["coord"]-phase,
                period
            )

            if abs(residual) > TOL:
                raise Exception(
                    "Grille incoherente : " + axis
                )

    return groups

def group_phase(lines, period):
    return circular_phase(
        [v["coord"] for v in lines],
        period
    )

def difference(top, bottom, period):
    return wrap(
        group_phase(bottom, period)
        - group_phase(top, period),
        period
    )

# ==================================================
# DEPLACER LE MOTIF SUPERIEUR
# ==================================================

def move_pattern(
    face, index, axis,
    delta, view, p
):
    if abs(delta) <= TOL:
        return

    ref = hatch_ref(face, index)

    c = p.X if axis == "X" else p.Y

    pl = make_plane(
        axis, c, view, p
    )

    doc.Regenerate()

    dim = make_dimension(
        ref, pl, axis, view, p
    )

    dim.IsLocked = True
    doc.Regenerate()

    vector = (
        XYZ(delta, 0, 0)
        if axis == "X"
        else XYZ(0, delta, 0)
    )

    ElementTransformUtils.MoveElement(
        doc, pl.Id, vector
    )

    doc.Regenerate()

    doc.Delete(dim.Id)
    doc.Delete(pl.Id)

    doc.Regenerate()

# ==================================================
# TRAITEMENT D'UN PLAFOND
# ==================================================

def process(e):
    p = center(e)

    top = get_face(e, True)
    bottom = get_face(e, False)

    top_periods = get_pattern(e, top)
    bottom_periods = get_pattern(e, bottom)

    check_compatibility(
        top_periods, bottom_periods
    )

    periods = top_periods

    vtop = get_view(ViewType.FloorPlan)
    vbottom = get_view(ViewType.CeilingPlan)

    top_lines = extract_lines(
        top, vtop, p, periods
    )

    bottom_lines = extract_lines(
        bottom, vbottom, p, periods
    )

    shifts = {}
    indices = {}

    for axis in ("X", "Y"):
        shifts[axis] = difference(
            top_lines[axis],
            bottom_lines[axis],
            periods[axis]
        )

        selected = min(
            top_lines[axis],
            key=lambda q: abs(
                q["coord"] -
                (p.X if axis == "X" else p.Y)
            )
        )

        indices[axis] = selected["index"]

    report = {
        "Id": eid(e),
        "Motif_X_mm": mm(periods["X"]),
        "Motif_Y_mm": mm(periods["Y"]),
        "Decalage_X_mm": mm(shifts["X"]),
        "Decalage_Y_mm": mm(shifts["Y"])
    }

    aligned = all(
        abs(shifts[a]) <= TOL
        for a in ("X", "Y")
    )

    if aligned:
        report["Statut"] = "DEJA_ALIGNE"
        return report

    if not EXECUTE:
        report["Statut"] = "A_ALIGNER"
        return report

    geometry_before = bbox(e)

    # Modification de la grille superieure
    for axis in ("X", "Y"):
        move_pattern(
            top,
            indices[axis],
            axis,
            shifts[axis],
            vtop,
            p
        )

    doc.Regenerate()

    # Relecture des references apres deplacement
    new_top = extract_lines(
        get_face(e, True),
        vtop,
        p,
        periods
    )

    residuals = {}

    for axis in ("X", "Y"):
        residuals[axis] = difference(
            new_top[axis],
            bottom_lines[axis],
            periods[axis]
        )

    report["Residuel_X_mm"] = mm(
        residuals["X"]
    )

    report["Residuel_Y_mm"] = mm(
        residuals["Y"]
    )

    if any(
        abs(v) > TOL
        for v in residuals.values()
    ):
        raise Exception(
            "Alignement non confirme"
        )

    geometry_after = bbox(e)

    if any(
        abs(a-b) > 1e-7
        for a, b in zip(
            geometry_before,
            geometry_after
        )
    ):
        raise Exception(
            "Geometrie du plafond modifiee"
        )

    report["Statut"] = "ALIGNE"
    return report

# ==================================================
# EXECUTION SUR LES PLAFONDS SELECTIONNES
# ==================================================

TransactionManager.Instance.ForceCloseTransaction()

results = []

stats = {
    "TOTAL": len(ceilings),
    "ALIGNES": 0,
    "DEJA_ALIGNES": 0,
    "A_ALIGNER": 0,
    "ERREURS": 0
}

for ceiling in ceilings:
    t = Transaction(
        doc,
        "Aligner plafond " + eid(ceiling)
    )

    started = False

    try:
        t.Start()
        started = True

        report = process(ceiling)

        if EXECUTE:
            t.Commit()
        else:
            t.RollBack()

        started = False
        results.append(report)

        status = report["Statut"]

        if status == "ALIGNE":
            stats["ALIGNES"] += 1
        elif status == "DEJA_ALIGNE":
            stats["DEJA_ALIGNES"] += 1
        elif status == "A_ALIGNER":
            stats["A_ALIGNER"] += 1

    except Exception as ex:
        if started:
            try:
                t.RollBack()
            except:
                pass

        stats["ERREURS"] += 1

        results.append({
            "Id": eid(ceiling),
            "Statut": "ERREUR",
            "Message": str(ex)
        })

# ==================================================
# RESULTAT DYNAMO
# ==================================================

OUT = {
    "MODE": (
        "EXECUTION" if EXECUTE
        else "DIAGNOSTIC"
    ),
    "TYPE_PLAFOND": selected_type.Name,
    "NIVEAU": selected_level.Name,
    "BILAN": stats,
    "DETAILS": results
}
# ----------------------------------------
watch = Watch(python_script)
