# Dynamo graph RVT_Change_Chemin_Reseaux.dyn (Dynamo 2.16.4.10216)

n01_old_path = StringInput("Z:\H")  # "01.Old Path"; graph input
n02_new_path = StringInput("A:\I03rgu\H")  # "02.New Path"; graph input
python_script = Python(IN[0]=n01_old_path, IN[1]=n02_new_path)  # CPython3
# ---------- python_script.python (48 lines) ----------
import clr
clr.AddReference('RevitAPI')
clr.AddReference('RevitServices')
from Autodesk.Revit.DB import *
from RevitServices.Persistence import DocumentManager
from RevitServices.Transactions import TransactionManager

doc = DocumentManager.Instance.CurrentDBDocument

old_path = IN[0]  # ex: "Z:\\H"
new_path = IN[1]  # ex: "A:\\I03rgu\\H"

updated = []

TransactionManager.Instance.EnsureInTransaction(doc)

# Liens Revit (.rvt)
revit_links = FilteredElementCollector(doc).OfClass(RevitLinkType)
for link in revit_links:
    if not link.IsExternalFileReference():  # ← garde-fou ajouté
        continue
    external_ref = link.GetExternalFileReference()
    current_path = ModelPathUtils.ConvertModelPathToUserVisiblePath(
        external_ref.GetAbsolutePath()
    )
    if old_path in current_path:
        new_full_path = current_path.replace(old_path, new_path)
        new_model_path = ModelPathUtils.ConvertUserVisiblePathToModelPath(new_full_path)
        link.LoadFrom(new_model_path, WorksetConfiguration())
        updated.append("[RVT] " + new_full_path)

# Liens CAD/DWG (.dwg)
cad_links = FilteredElementCollector(doc).OfClass(CADLinkType)
for link in cad_links:
    if not link.IsExternalFileReference():  # ← garde-fou ajouté (exclut les imports)
        continue
    external_ref = link.GetExternalFileReference()
    current_path = ModelPathUtils.ConvertModelPathToUserVisiblePath(
        external_ref.GetAbsolutePath()
    )
    if old_path in current_path:
        new_full_path = current_path.replace(old_path, new_path)
        link.LoadFrom(new_full_path)
        updated.append("[DWG] " + new_full_path)

TransactionManager.Instance.TransactionTaskDone()

OUT = "{} lien(s) mis à jour :\n{}".format(len(updated), "\n".join(updated))
# ----------------------------------------
results = Watch(python_script)  # "03.Results"; graph output
