# Dynamo graph RVT_SDP.dyn (Dynamo 2.16.4.10216)
# author: CHU_BDX
# packages: bimorphNodes 5.1.3

n1_plan_dwg = DSModelElementSelection()  # "1.Plan DWG"; 1 picked in the model; graph input
n2_calque_dwg = CustomSelection("Surface de Plancher", items={Surface de Plancher: "Surface_Plancher", Emprise au Sol: "Surface _ Emprise au sol"})  # "2.Calque DWG"; graph input
niveau = Levels("S2")  # "3.Niveau"; graph input

# group: SET Limites
curvesFromCADLayers = CAD.CurvesFromCADLayers(importInstance=n1_plan_dwg, layerNames=n2_calque_dwg)
flatten = List.Flatten(list=curvesFromCADLayers.Curve)
level_plane = Python(IN[0]=niveau)  # IronPython2
# ---------- level_plane.python (24 lines) ----------
#Alban de Chasteigner 2020
#twitter : @geniusloci_bim
#geniusloci.bim@gmail.com

import clr
clr.AddReference('RevitAPI')
import Autodesk
from Autodesk.Revit.DB import *

clr.AddReference('RevitNodes')
import Revit
clr.ImportExtensions(Revit.GeometryConversion)

levels = UnwrapElement(IN[0]) if isinstance(IN[0],list) else [UnwrapElement(IN[0])]
	
planes = []
for level in levels:
	elev=level.ProjectElevation
	point=XYZ(0,0,elev)
	planes.append(Plane.CreateByNormalAndOrigin(XYZ.BasisZ,point).ToPlane())

	
if isinstance(IN[0], (list)): OUT = planes
else: OUT = planes[0]
# ----------------------------------------
pullOntoPlane = Curve.PullOntoPlane(curve=flatten, plane=level_plane)
code_block = CodeBlock { Document.Current.ActiveView; }
python_script = Python(IN[0]=pullOntoPlane, IN[1]=code_block)  # IronPython2
# ---------- python_script.python (34 lines) ----------
import clr
clr.AddReference('RevitAPI')
from Autodesk.Revit.DB import *

clr.AddReference("RevitNodes")
import Revit
clr.ImportExtensions(Revit.GeometryConversion)

clr.AddReference("RevitServices")
import RevitServices
from RevitServices.Persistence import DocumentManager
from RevitServices.Transactions import TransactionManager

doc = DocumentManager.Instance.CurrentDBDocument
curves = UnwrapElement(IN[0])
areaView = UnwrapElement(IN[1])  # Doit être une ViewPlan de type Area

TransactionManager.Instance.EnsureInTransaction(doc)
o = areaView.Origin
n = areaView.ViewDirection
if o and n: 
    sketchplane = SketchPlane.Create(doc, Plane.CreateByNormalAndOrigin(n, o))
    doccreation = doc.Create
    elementlist = list()
    for curve in curves:
        # NewAreaBoundaryLine crée une ligne à la fois (pas de CurveArray)
        areaBoundary = doccreation.NewAreaBoundaryLine(sketchplane, curve.ToRevitType(), areaView)
        elementlist.append(areaBoundary)
else: 
    elementlist = []
TransactionManager.Instance.TransactionTaskDone()

if isinstance(IN[0], list): OUT = elementlist
else: OUT = elementlist[0] if elementlist else None
# ----------------------------------------
byElements = Group.ByElements(elements=python_script)

watch = Watch(python_script)  # graph output
